# Dynamo graph airbike-family-example.dyn "Assault_Fitness_AirBike_Pro_X_Revit2027_Functional" (Dynamo 4.0.2)
# One family/type. Functional assembly refinement: coherent crank/linkage joints, saddle mounting, fan clearance, console support and open pedals. 1300x610x1240 mm. Inferred details are visual approximations.

output_folder_directory_path = Directory("")  # graph input
generic_template_folder = Directory("")  # "Generic template folder - Directory Path"; graph input
create_family_false_preview_true = BoolSelector(false)  # "Create family - False preview / True save"; graph input
create_airbike_pro_x_functional = Python(outputFolder=output_folder_directory_path, genericTemplateFolder=generic_template_folder, createFamily=create_family_false_preview_true)  # "Create AirBike Pro X - functional assembly"; PythonNet3
# ---------- create_airbike_pro_x_functional.python (524 lines) ----------
"""One family/type, with a detailed AirBike visual model. Dimensions in mm.
Overall size and black finish come from the supplied FDV PDF. Part sizes and
positions below are approximations for visualization, not fabrication data.
IN = [output_folder, generic_template_directory, create_family].
"""
import math
from pathlib import Path

MODEL = 'Assault Fitness AirBike Pro X'
TYPE = 'AirBike_Pro_X_1300x610x1240mm'
FILE = 'Assault_Fitness_AirBike_Pro_X_Functional.rfa'
SIZE = [1300.0, 610.0, 1240.0]
RGB = [25, 25, 25]


def _reference_shapes():
    specs = []
    rubber, steel, red, screen = [14,14,14], [150,154,158], [190,35,35], [67,78,77]
    def add(name, kind, color=None, **values):
        values.update(name=name, kind=kind, color=color or RGB)
        specs.append(values)
    def box(name, center, size, color=None):
        add(name,'box',color,center=center,size=size)
    def tube(name,start,end,r,color=None):
        add(name,'cylinder',color,start=start,end=end,size=r)
    def bend(name,start,mid,end,r,color=None):
        add(name,'sweep',color,start=start,mid=mid,end=end,size=r)
    def polygon(name,points,axis,depth,color=None):
        add(name,'polygon',color,points=points,axis=axis,depth=depth)
    def hoop(name,y,r,inner,depth):
        add(name,'ring',start=[350,y,420],end=[350,y+depth,420],size=r,inner=inner)
    def capsule(name,x,y,z,half_length,r,depth):
        if depth < 0:
            y,depth=y+depth,-depth
        points=[]
        for cx, angles in ((x+half_length,range(-90,91,15)),(x-half_length,range(90,271,15))):
            points.extend([[cx+r*math.cos(math.radians(a)),y,z+r*math.sin(math.radians(a))] for a in angles])
        polygon(name,points,[0,1,0],depth)
    def flat_bar(name,start,end,width,depth,color=None):
        dx,dz=end[0]-start[0],end[2]-start[2]
        length=math.sqrt(dx*dx+dz*dz)
        nx,nz=-dz/length*width/2,dx/length*width/2
        points=[[p[0]+sign*nx,p[1]-depth/2,p[2]+sign*nz]
                for p,sign in ((start,-1),(end,-1),(end,1),(start,1))]
        polygon(name,points,[0,1,0],depth,color)
    def smooth_outline(outline,count=5):
        result=[]
        for i in range(len(outline)):
            p0,p1,p2,p3=[outline[j%len(outline)] for j in (i-1,i,i+1,i+2)]
            for step in range(count):
                t=step/float(count)
                result.append([0.5*(2*p1[k]+(-p0[k]+p2[k])*t+
                    (2*p0[k]-5*p1[k]+4*p2[k]-p3[k])*t*t+
                    (-p0[k]+3*p1[k]-3*p2[k]+p3[k])*t*t*t) for k in (0,1)])
        return result
    # Rounded stabilizers and four leveling feet; PDF overall width retained.
    capsule('Front stabilizer',250,-305,62,38,24,610)
    capsule('Rear stabilizer',1235,-250,62,41,24,500)
    for x in (250,1235):
        for side in (-1,1):
            y=side*(265 if x==250 else 210)
            tube('Leveling rubber foot',[x,y,0],[x,y,30],24,rubber)
            tube('Leveling foot screw',[x,y,30],[x,y,44],10,steel)
    for side in (-1,1):
        tube('Front transport wheel',[250,side*282,42],[250,side*302,42],32,rubber)
        tube('Transport wheel hub',[250,side*282,42],[250,side*302,42],13,steel)
    flat_bar('Lower rectangular frame',[290,0,100],[1170,0,100],42,54)
    flat_bar('Rear diagonal rectangular frame',[790,0,385],[1170,0,104],62,54)
    flat_bar('Upper frame cross member',[770,0,425],[410,0,465],52,54)
    # Manufacturer specifies a 27 inch fan; guard has clearance around blades.
    for side in (-1,1):
        hoop('Fan guard outer rim',side*96-2,350,345,4)
        hoop('Fan guard bead',side*104-2,345,342,4)
        # Shallow dished faces, with the central guards protruding toward the cranks.
        for radius in range(92,339,12):
            y=side*(102+39*(1-(radius/350.0)**2))
            hoop('Dished fan guard ring',y-0.9,radius,radius-1.5,1.8)
        for i in range(64):
            a=2*math.pi*i/64
            def point(r,y):
                return [350+r*math.cos(a),side*y,420+r*math.sin(a)]
            bend('Dished fan guard radial wire',point(89,138.5),point(217,126),point(345,103),1.15)
    for i in range(8):
        a=2*math.pi*i/8
        points=[[350+r*math.cos(a+t),-24,420+r*math.sin(a+t)]
                for r,t in ((80,0),(342.9,0.05),(342.9,0.21),(80,0.28))]
        polygon('Fan steel blade',points,[0,1,0],48)
    tube('Fan rotor hub',[350,-65,420],[350,65,420],77)
    for side in (-1,1):
        tube('Fan center cover',[350,side*132,420],[350,side*142,420],91)
        tube('Fan bearing boss',[350,side*142,420],[350,side*153,420],27)
    for i in range(48):
        a=2*math.pi*i/48
        tube('Fan perimeter wire',[350+346*math.cos(a),-102,420+346*math.sin(a)],
             [350+346*math.cos(a),102,420+346*math.sin(a)],1.3)
    cover=smooth_outline([(862,423),(889,369),(856,299),(748,206),
        (679,190),(595,221),(565,280),(586,337),(675,363),(725,447),(796,468)])
    shroud_sections=[[[730+(x-730)*scale,y,330+(z-330)*scale] for x,z in cover]
                     for y,scale in ((-77,0.94),(-65,1.0),(65,1.0),(77,0.94))]
    add('Contoured belt-drive enclosure','loft',sections=shroud_sections)
    for side in (-1,1):
        tube('Crank circular cover',[790,side*76,400],[790,side*83,400],93)
        for i in range(5):
            a=2*math.pi*i/5
            tube('Drive cover screw',[790+82*math.cos(a),side*83,400+82*math.sin(a)],
                 [790+82*math.cos(a),side*86,400+82*math.sin(a)],3.5,rubber)
    tube('Crank hub',[790,-84,400],[790,84,400],58)
    flat_bar('Rectangular seat post sleeve',[825,0,420],[897,0,740],63,56)
    flat_bar('Chrome rectangular adjustable post',[885,0,700],[925,0,873],35,34,steel)
    capsule('Seat fore-aft slider',949,-30,866,89,21,60)
    tube('Seat adjustment knob',[871,-32,715],[871,-68,715],15,rubber)
    tube('Fore-aft lock shaft',[989,0,845],[989,0,823],8,steel)
    tube('Fore-aft adjustment knob',[989,0,805],[989,0,826],17,rubber)
    for side in (-1,1):
        y=side*28
        tube('Saddle rail horizontal',[880,y,924],[978,y,924],5.5,steel)
        bend('Saddle rail bend',[978,y,924],[1001,y,913],[1008,y,890],5.5,steel)
        tube('Saddle slider clamp',[971,y,886],[1008,y,886],8)
        for z in (763,786,809,832):
            x=885+(z-700)*40/173.0
            tube('Seat height index hole',[x,side*17,z],[x,side*18,z],3,rubber)
    # Corresponding rounded outline sections create a beveled upholstered saddle.
    outline=[(818,-24),(844,-38),(892,-46),(942,-102),(983,-115),(1027,-100),
             (1047,-61),(1050,0),(1047,61),(1027,100),(983,115),(942,102),(892,46),(844,38),(818,24)]
    # Periodic Catmull-Rom outline, sampled consistently across loft sections.
    smooth=[]
    for i in range(len(outline)):
        p0,p1,p2,p3=[outline[j%len(outline)] for j in (i-1,i,i+1,i+2)]
        for step in range(4):
            t=step/4
            smooth.append([0.5*((2*p1[k])+(-p0[k]+p2[k])*t+
                (2*p0[k]-5*p1[k]+4*p2[k]-p3[k])*t*t+
                (-p0[k]+3*p1[k]-3*p2[k]+p3[k])*t*t*t) for k in (0,1)])
    sections=[[[935+(x-935)*scale,y*scale,z] for x,y in smooth]
              for z,scale in ((917,0.85),(924,0.98),(938,1.0),(950,0.92),(955,0.72))]
    add('Sculpted upholstered saddle','loft',rubber,sections=sections)
    # Console mast uses an actual curved sweep, rather than joined straight bars.
    tube('Console mast lower',[420,0,650],[500,0,940],23)
    bend('Console mast curve',[500,0,940],[501,0,1010],[474,0,1070],23)
    tube('Console mast upper',[474,0,1070],[420,0,1130],23)
    def console_point(s,y,h):
        return [430+0.85*s+0.5268*h,y,1177-0.5268*s+0.85*h]
    def rounded_panel(length,width,r):
        points=[]
        for x,y,angle in ((length/2-r,width/2-r,0),(-length/2+r,width/2-r,90),
                          (-length/2+r,-width/2+r,180),(length/2-r,-width/2+r,270)):
            for step in range(7):
                a=math.radians(angle+step*15)
                points.append([x+r*math.cos(a),y+r*math.sin(a)])
        return points
    panel=rounded_panel(218,188,14)
    add('Rounded inclined console housing','loft',sections=[
        [console_point(x*scale,y*scale,h) for x,y in panel]
        for h,scale in ((-32,0.91),(-24,1.0),(0,1.0))])
    bezel=rounded_panel(139,145,9)
    polygon('Console screen bezel',[console_point(x-20,y,0.5) for x,y in bezel],
            [0.5268,0,0.85],2,rubber)
    lcd=rounded_panel(121,126,5)
    polygon('LCD glass',[console_point(x-20,y,2.6) for x,y in lcd],
            [0.5268,0,0.85],1,screen)
    for row in (67,88):
        for y in (-59,-30,0,30,59):
            tube('Console button',console_point(row,y,1),console_point(row,y,4),6,rubber)
    # Bottle holder visible in the supplied photograph; open cup, no bottle.
    add('Bottle holder','ring',start=[315,108,1108],end=[315,108,1240],size=38,inner=33)
    tube('Bottle holder base',[315,108,1101],[315,108,1108],38)
    flat_bar('Bottle holder bracket',[315,81,1156],[376,81,1156],24,12)
    for side in (-1,1):
        y=side*208
        # Broad support plates, moving arms and smooth quarter-circle grip bends.
        polygon('Front support plate',[[218,side*150,90],[300,side*150,83],
            [444,side*150,418],[374,side*150,436]],[0,side,0],30)
        tube('Handle arm',[407,y,395],[505,y,1087],16)
        bend('Handle upper bend',[505,y,1087],[529.6,y,1126],[573.2,y,1141.2],16)
        tube('Handle grip',[573.2,y,1141.2],[749,y,1141.2],18,rubber)
        tube('Red handle accent',[478,y-17*side,970],[493,y-17*side,1038],3,red)
        capsule('Handle linkage',590,side*182,382,177,19,side*18)
        tube('Handle pivot',[407,side*151,400],[407,side*215,400],26)
        tube('Handle pivot bolt',[407,side*215,400],[407,side*220,400],10,steel)
        tube('Linkage rear pin',[767,side*175,382],[767,side*204,382],11,steel)
        tube('Foot peg',[350,side*115,420],[350,side*202,420],15,rubber)
        tube('Crank axle',[790,0,400],[790,side*152,400],17,steel)
        px,pz=790+side*22,400-side*139
        flat_bar('Flat steel crank arm',[790,side*152,400],[px,side*152,pz],25,16)
        tube('Pedal spindle',[px,side*150,pz],[px,side*213,pz],8,steel)
        box('Pedal body',[px,side*211,pz],[124,90,20],rubber)
        for dx in (-48,48):
            box('Pedal outer rail',[px+dx,side*211,pz+13],[12,90,6])
        for dy in (-35,35):
            box('Pedal end rail',[px,side*211+dy,pz+13],[108,12,6])
    return specs



def shape_specs():
    specs = _reference_shapes()
    steel, rubber = [150,154,158], [14,14,14]
    replace_names = {
        'Lower rectangular frame','Handle linkage','Handle pivot','Handle pivot bolt',
        'Linkage rear pin','Crank axle','Flat steel crank arm','Pedal spindle',
        'Pedal body','Pedal outer rail','Pedal end rail','Seat adjustment knob',
        'Saddle rail horizontal','Saddle rail bend','Saddle slider clamp',
        'Fan rotor hub','Console mast upper','Console mast lower','Console mast curve','Upper frame cross member',
    }
    specs = [s for s in specs if s['name'] not in replace_names]
    def add(name,kind,color=None,**values):
        values.update(name=name,kind=kind,color=color or RGB)
        specs.append(values)
    def tube(name,start,end,r,color=None):
        add(name,'cylinder',color,start=start,end=end,size=r)
    def box(name,center,size,color=None):
        add(name,'box',color,center=center,size=size)
    def bar(name,start,end,width,depth,color=None):
        dx,dz=end[0]-start[0],end[2]-start[2]
        length=math.hypot(dx,dz)
        nx,nz=-dz/length*width/2,dx/length*width/2
        points=[[p[0]+sign*nx,p[1]-depth/2,p[2]+sign*nz]
                for p,sign in ((start,-1),(end,-1),(end,1),(start,1))]
        add(name,'polygon',color,points=points,axis=[0,1,0],depth=depth)

    # A continuous base connects both stabilizers. Only the four feet meet z=0.
    bar('Continuous base frame',[250,0,100],[1235,0,100],42,54)
    for side in (-1,1):
        bar('Frame beside fan',[770,side*170,425],[407,side*170,460],38,32)
    bar('Console rear support',[770,0,425],[651,0,667],44,54)
    tube('Fan rotor hub',[350,-65,420],[350,65,420],83)
    tube('Fan axle',[350,-169,420],[350,169,420],16,steel)
    # The belt shroud sits beside the rotor, rather than passing through its blades.
    for spec in specs:
        if spec['name']=='Contoured belt-drive enclosure':
            for section in spec['sections']:
                for point in section:
                    point[1]=point[1]*0.30-179
        elif spec['name']=='Front support plate':
            for p in spec['points']:
                if p[2]>400:
                    p[2]+=65
        elif spec['name']=='Handle arm':
            spec['start'][2]=460
    # Connect the side belt cover back to the crank housing.
    tube('Drive cover crank collar',[790,-202,400],[790,-77,400],43)
    tube('Drive cover upper mounting boss',[730,-155,440],[730,-64,440],10)

    # The visible saddle rails connect to a clamp and to the underside of the seat.
    for side in (-1,1):
        y=side*28
        tube('Saddle rail',[885,y,906],[980,y,906],5.5,steel)
        add('Saddle rail return','sweep',steel,start=[980,y,906],mid=[1000,y,897],end=[1008,y,876],size=5.5)
        box('Saddle rail attachment',[915,y,912],[60,18,14])
        tube('Saddle clamp cross pin',[997,side*12,879],[997,side*40,879],8,steel)
    box('Saddle clamp block',[997,0,881],[35,65,12])
    tube('Seat height locking shaft',[891,-27,715],[891,-50,715],6,steel)
    tube('Seat height locking knob',[891,-50,715],[891,-69,715],15,rubber)

    # Attach the inclined console at its actual underside plane.
    add('Continuous curved console mast','sweep',start=[655,0,660],mid=[505,0,945],end=[414.7228,0,1152.35],size=23)
    def cp(s,y,h):
        return [430+0.85*s+0.5268*h,y,1177-0.5268*s+0.85*h]
    add('Console mounting plate','polygon',points=[cp(x,y,-33) for x,y in [(-30,-35),(30,-35),(30,35),(-30,35)]],
        axis=[0.5268,0,0.85],depth=5)

    # Each linkage joins a lower handle lever and the corresponding crank pin.
    # Both crank arms share one axle and are 180 degrees apart in this static pose.
    for side in (-1,1):
        arm_y=side*208
        crank_y=side*218
        pivot=[407,arm_y,460]
        crank=[790,crank_y,400]
        pin=[790+side*22,crank_y,400-side*139]
        # Intersect the lever-radius and linkage-length circles to obtain a
        # compatible pose, using identical 135 mm levers and 430 mm rods.
        dx,dz=pin[0]-pivot[0],pin[2]-pivot[2]
        distance=math.hypot(dx,dz)
        along=(135**2-430**2+distance**2)/(2*distance)
        offset=math.sqrt(135**2-along**2)
        lever=[pivot[0]+along*dx/distance+offset*dz/distance,arm_y,
               pivot[2]+along*dz/distance-offset*dx/distance]
        rotation=math.atan2(pivot[2]-lever[2],pivot[0]-lever[0])-math.atan2(627,98)
        for spec in specs:
            if spec['name'] in ('Handle arm','Handle upper bend','Handle grip','Red handle accent') and spec['start'][1]*side>0:
                for key in ('start','mid','end'):
                    if key in spec:
                        p=spec[key]
                        x,z=p[0]-pivot[0],p[2]-pivot[2]
                        p[0]=pivot[0]+x*math.cos(rotation)-z*math.sin(rotation)
                        p[2]=pivot[2]+x*math.sin(rotation)+z*math.cos(rotation)
        bar('Handle lower lever',pivot,lever,32,18)
        tube('Handle pivot shaft',[407,side*151,460],[407,side*228,460],19,steel)
        tube('Handle pivot housing',[407,side*188,460],[407,side*224,460],28)
        tube('Handle pivot cap',[407,side*224,460],[407,side*231,460],12,steel)
        bar('Crank to handle connecting rod',[lever[0],crank_y,lever[2]],pin,23,14)
        tube('Linkage handle pin',[lever[0],side*197,lever[2]],[lever[0],side*233,lever[2]],10,steel)
        tube('Linkage crank pin',[pin[0],side*205,pin[2]],[pin[0],side*234,pin[2]],10,steel)
        tube('Crank axle extension',[790,0,400],crank,17,steel)
        bar('Opposed crank arm',crank,pin,25,16)
        tube('Crank retaining cap',[790,side*226,400],[790,side*232,400],11,steel)
        tube('Pedal spindle',pin,[pin[0],side*267,pin[2]],8,steel)
        px,py,pz=pin[0],side*265,pin[2]
        # An open platform pedal with tread bars shows its bearing/spindle relationship.
        for dx in (-55,55):
            box('Pedal side frame',[px+dx,py,pz],[14,70,20],rubber)
        for dy in (-28,28):
            box('Pedal end frame',[px,py+dy,pz],[110,14,20],rubber)
        for dx in (-27,0,27):
            box('Pedal tread bar',[px+dx,py,pz+4],[9,56,12])
        tube('Pedal bearing barrel',[px,side*235,pz],[px,side*272,pz],12)
    return specs


def template_file(folder, app):
    if folder:
        base = Path(str(folder))
        for name in ('Metric Generic Model.rft', 'Generic Model.rft',
                     'English/Metric Generic Model.rft', 'English/Generic Model.rft'):
            path = base / name
            if path.is_file():
                return str(path.resolve())
        raise FileNotFoundError('Select the folder containing Metric Generic Model.rft.')
    return template_file(app.FamilyTemplatePath, app)


def make_solid(doc, spec, DB):
    def xyz(values):
        return DB.XYZ(*(DB.UnitUtils.ConvertToInternalUnits(float(v), DB.UnitTypeId.Millimeters) for v in values))
    def mm(value):
        return DB.UnitUtils.ConvertToInternalUnits(float(value), DB.UnitTypeId.Millimeters)
    if spec['kind'] in ('sweep','loft'):
        from System.Collections.Generic import List
        profiles = List[DB.CurveLoop]()
        if spec['kind'] == 'loft':
            for section in spec['sections']:
                points=[xyz(p) for p in section]
                profile=DB.CurveLoop()
                for i in range(len(points)):
                    profile.Append(DB.Line.CreateBound(points[i],points[(i+1)%len(points)]))
                profiles.Add(profile)
            options=DB.SolidOptions(DB.ElementId.InvalidElementId,DB.ElementId.InvalidElementId)
            solid=DB.GeometryCreationUtilities.CreateLoftGeometry(profiles,options)
        else:
            arc=DB.Arc.Create(xyz(spec['start']),xyz(spec['end']),xyz(spec['mid']))
            path=DB.CurveLoop()
            path.Append(arc)
            origin=arc.GetEndPoint(0)
            tangent=arc.ComputeDerivatives(0.0,True).BasisX.Normalize()
            reference=DB.XYZ.BasisZ if abs(tangent.Z)<0.9 else DB.XYZ.BasisY
            u=tangent.CrossProduct(reference).Normalize()
            v=tangent.CrossProduct(u).Normalize()
            profile=DB.CurveLoop()
            profile.Append(DB.Arc.Create(origin,mm(spec['size']),0,math.pi,u,v))
            profile.Append(DB.Arc.Create(origin,mm(spec['size']),math.pi,2*math.pi,u,v))
            profiles.Add(profile)
            solid=DB.GeometryCreationUtilities.CreateSweptGeometry(path,0,arc.GetEndParameter(0),profiles)
        return DB.FreeFormElement.Create(doc,solid)
    loop = DB.CurveArray()
    if spec['kind'] == 'polygon':
        points = [xyz(p) for p in spec['points']]
        origin, axis, depth = points[0], DB.XYZ(*spec['axis']), mm(spec['depth'])
        for i in range(len(points)):
            loop.Append(DB.Line.CreateBound(points[i], points[(i+1) % len(points)]))
    elif spec['kind'] == 'box':
        x, y, z = spec['center']
        sx, sy, sz = spec['size']
        points = [xyz([x - sx/2, y - sy/2, z - sz/2]), xyz([x + sx/2, y - sy/2, z - sz/2]),
                  xyz([x + sx/2, y + sy/2, z - sz/2]), xyz([x - sx/2, y + sy/2, z - sz/2])]
        origin, axis, depth = points[0], DB.XYZ.BasisZ, mm(sz)
        for i in range(4):
            loop.Append(DB.Line.CreateBound(points[i], points[(i+1) % 4]))
    else:
        origin, end = xyz(spec['start']), xyz(spec['end'])
        direction = end - origin
        depth, axis = direction.GetLength(), direction.Normalize()
        reference = DB.XYZ.BasisZ if abs(axis.Z) < 0.9 else DB.XYZ.BasisY
        u = axis.CrossProduct(reference).Normalize()
        v = axis.CrossProduct(u).Normalize()
        if spec['kind'] in ('cylinder', 'ring'):
            radius = mm(spec['size'])
            loop.Append(DB.Arc.Create(origin, radius, 0.0, math.pi, u, v))
            loop.Append(DB.Arc.Create(origin, radius, math.pi, 2*math.pi, u, v))
        else:
            half = mm(spec['size']) / 2
            points = [origin + u.Multiply(a*half) + v.Multiply(b*half)
                      for a, b in [(-1,-1), (1,-1), (1,1), (-1,1)]]
            for i in range(4):
                loop.Append(DB.Line.CreateBound(points[i], points[(i+1) % 4]))
    profile = DB.CurveArrArray()
    profile.Append(loop)
    if spec['kind'] == 'ring':
        inner = DB.CurveArray()
        radius = mm(spec['inner'])
        inner.Append(DB.Arc.Create(origin, radius, 0.0, math.pi, u, v))
        inner.Append(DB.Arc.Create(origin, radius, math.pi, 2*math.pi, u, v))
        profile.Append(inner)
    plane = DB.SketchPlane.Create(doc, DB.Plane.CreateByNormalAndOrigin(axis, origin))
    return doc.FamilyCreate.NewExtrusion(True, profile, plane, depth)


def run(output_folder, template_folder, create):
    if not isinstance(create, bool):
        raise ValueError('Use the Boolean input node.')
    output = Path(str(output_folder)).expanduser().resolve() if output_folder else Path.home() / 'Documents/AirBike_Pro_X'
    target = output / FILE
    result = {'status': 'preview', 'model': MODEL, 'type': TYPE, 'category': 'Specialty Equipment',
              'overall_dimensions_mm': SIZE, 'color_rgb': RGB, 'shape_specs': shape_specs(),
              'output_file': str(target), 'modeling_basis': 'Astra revision from supplied image and manufacturer photographs. PDF overall dimensions retained; manufacturer page has conflicting dimension tables. 27 inch fan diameter from manufacturer. Other part dimensions approximated.'}
    if not create:
        return result
    if target.exists():
        raise FileExistsError('Existing RFA is preserved. Select a new output folder.')
    import clr
    clr.AddReference('RevitAPI')
    clr.AddReference('RevitServices')
    import Autodesk.Revit.DB as DB
    from RevitServices.Persistence import DocumentManager
    from RevitServices.Transactions import TransactionManager
    uiapp = DocumentManager.Instance.CurrentUIApplication
    if uiapp is None or str(uiapp.Application.VersionNumber).split('.')[0] != '2027':
        raise ValueError('Run in Revit 2027.x.')
    app = uiapp.Application
    active = DocumentManager.Instance.CurrentDBDocument
    if active is None or active.IsFamilyDocument:
        raise ValueError('Launch Dynamo from an ordinary Revit project.')
    template = template_file(template_folder, app)
    TransactionManager.Instance.ForceCloseTransaction()
    if active.IsModifiable:
        raise RuntimeError('Close the active project transaction first.')
    doc = app.NewFamilyDocument(template)
    transaction = None
    try:
        if doc.OwnerFamily.FamilyCategory.Id != DB.Category.GetCategory(doc, DB.BuiltInCategory.OST_GenericModel).Id:
            raise ValueError('Choose an empty non-hosted Generic Model template.')
        host = doc.OwnerFamily.get_Parameter(DB.BuiltInParameter.FAMILY_HOSTING_BEHAVIOR)
        if host is not None and host.AsInteger() != 0:
            raise ValueError('Hosted templates are unsupported.')
        if list(DB.FilteredElementCollector(doc).OfClass(DB.GenericForm)):
            raise ValueError('Use a template without existing geometry.')
        transaction = DB.Transaction(doc, 'Create AirBike Pro X')
        if transaction.Start() != DB.TransactionStatus.Started:
            raise RuntimeError('Family transaction could not start.')
        category = DB.Category.GetCategory(doc, DB.BuiltInCategory.OST_SpecialityEquipment)
        doc.OwnerFamily.FamilyCategory = category
        vertical = doc.OwnerFamily.get_Parameter(DB.BuiltInParameter.FAMILY_ALWAYS_VERTICAL)
        if vertical is not None and not vertical.IsReadOnly:
            vertical.Set(1)
        workplane = doc.OwnerFamily.get_Parameter(DB.BuiltInParameter.FAMILY_WORK_PLANE_BASED)
        if workplane is not None and not workplane.IsReadOnly:
            workplane.Set(0)
        manager = doc.FamilyManager
        wanted = next((t for t in manager.Types if t.Name == TYPE), None)
        if wanted is None:
            wanted = manager.NewType(TYPE)
        for old in list(manager.Types):
            if old.Name != TYPE:
                manager.CurrentType = old
                manager.DeleteCurrentType()
        manager.CurrentType = wanted
        for name, value in zip(('Length', 'Width', 'Height'), SIZE):
            param = manager.AddParameter('AB_' + name, DB.GroupTypeId.Geometry, DB.SpecTypeId.Length, False)
            manager.SetFormula(param, str(value) + ' mm')
        model = manager.AddParameter('AB_Model', DB.GroupTypeId.Data, DB.SpecTypeId.String.Text, False)
        manager.Set(model, MODEL)
        material_param = manager.AddParameter('AB_HousingMaterial', DB.GroupTypeId.Materials, DB.SpecTypeId.Reference.Material, False)
        material_id = DB.Material.Create(doc, 'AirBike_Black_25_25_25')
        material = doc.GetElement(material_id)
        material.UseRenderAppearanceForShading = False
        material.Color = DB.Color(*RGB)
        material.Transparency = 0
        manager.Set(material_param, material_id)
        materials={tuple(RGB): material_id}
        for rgb in {tuple(s.get('color',RGB)) for s in result['shape_specs']}:
            if rgb not in materials:
                mid=DB.Material.Create(doc,'AirBike_Finish_'+'_'.join(str(c) for c in rgb))
                mat=doc.GetElement(mid)
                mat.UseRenderAppearanceForShading=False
                mat.Color=DB.Color(*rgb)
                mat.Transparency=0
                materials[rgb]=mid
        bodies = []
        for shape in result['shape_specs']:
            try:
                body = make_solid(doc, shape, DB)
            except Exception as error:
                raise RuntimeError('Could not build '+shape['name']+': '+str(error))
            material_slot=body.get_Parameter(DB.BuiltInParameter.MATERIAL_ID_PARAM)
            rgb=tuple(shape.get('color',RGB))
            if rgb==tuple(RGB):
                manager.AssociateElementParameterToFamilyParameter(material_slot,material_param)
            else:
                material_slot.Set(materials[rgb])
            bodies.append(body)
        doc.Regenerate()
        bounds = [body.get_BoundingBox(None) for body in bodies]
        minimum = [min(getattr(b.Min, axis) for b in bounds) for axis in 'XYZ']
        maximum = [max(getattr(b.Max, axis) for b in bounds) for axis in 'XYZ']
        actual = [DB.UnitUtils.ConvertFromInternalUnits(b-a, DB.UnitTypeId.Millimeters)
                  for a, b in zip(minimum, maximum)]
        if any(abs(a-b) > 0.1 for a, b in zip(actual, SIZE)):
            raise RuntimeError('Overall geometry size check failed: ' + str(actual))
        if len(list(manager.Types)) != 1:
            raise RuntimeError('Expected exactly one type.')
        if transaction.Commit() != DB.TransactionStatus.Committed:
            raise RuntimeError('Family transaction did not commit.')
        output.mkdir(parents=True, exist_ok=True)
        options = DB.SaveAsOptions()
        options.OverwriteExistingFile = False
        try:
            doc.SaveAs(str(target), options)
        finally:
            options.Dispose()
        result.update({'status': 'created', 'verified_dimensions_mm': actual,
                       'warnings': [str(w.GetDescriptionText()) for w in doc.GetWarnings()]})
        return result
    finally:
        if transaction is not None:
            if transaction.GetStatus() == DB.TransactionStatus.Started:
                transaction.RollBack()
            transaction.Dispose()
        doc.Close(False)


if 'IN' in globals():
    try:
        OUT = run(IN[0], IN[1], IN[2])
    except Exception as error:
        OUT = {'status': 'failed', 'error': str(error)}
# ----------------------------------------
result = Watch(create_airbike_pro_x_functional)
colored_geometry_preview = Python(familyResult=create_airbike_pro_x_functional)  # PythonNet3
# ---------- colored_geometry_preview.python (67 lines) ----------
import clr
clr.AddReference('ProtoGeometry')
clr.AddReference('DSCoreNodes')
clr.AddReference('GeometryColor')
from Autodesk.DesignScript.Geometry import Point, Vector, CoordinateSystem, Cuboid, Cylinder, Polygon, Arc, Circle, Solid
from DSCore import Color
from Modifiers import GeometryColor


def value(data, key):
    return data.ValueAtKey(key) if hasattr(data, 'ValueAtKey') else data[key]


OUT = []
try:
    specs = value(IN[0], 'shape_specs')
    rgb = value(IN[0], 'color_rgb')
except (KeyError, TypeError):
    specs = []
    rgb = [25, 25, 25]
color = Color.ByARGB(255, int(rgb[0]), int(rgb[1]), int(rgb[2]))
for spec in specs or []:
    try:
        part_rgb=value(spec,'color')
    except KeyError:
        part_rgb=rgb
    color=Color.ByARGB(255,*[int(c) for c in part_rgb])
    kind = value(spec, 'kind')
    if kind == 'loft':
        sections=[Polygon.ByPoints([Point.ByCoordinates(*[float(v) for v in p]) for p in section])
                  for section in value(spec,'sections')]
        geometry=Solid.ByLoft(sections)
    elif kind == 'sweep':
        start,mid,end=[Point.ByCoordinates(*[float(v) for v in value(spec,k)]) for k in ('start','mid','end')]
        # Dynamo expects sequential points; Revit Arc.Create uses start/end/mid.
        path=Arc.ByThreePoints(start,mid,end)
        if path.EndPoint.DistanceTo(end) > 0.01:
            raise ValueError('Arc endpoint mismatch: '+str(value(spec,'name')))
        profile=Circle.ByCenterPointRadiusNormal(start,float(value(spec,'size')),path.TangentAtParameter(0.0))
        geometry=Solid.BySweep(profile,path)
    elif kind == 'polygon':
        points = [Point.ByCoordinates(*[float(v) for v in p]) for p in value(spec, 'points')]
        direction = Vector.ByCoordinates(*[float(v)*float(value(spec, 'depth')) for v in value(spec, 'axis')])
        geometry = Polygon.ByPoints(points).ExtrudeAsSolid(direction)
    elif kind == 'box':
        center = Point.ByCoordinates(*[float(v) for v in value(spec, 'center')])
        sx, sy, sz = [float(v) for v in value(spec, 'size')]
        geometry = Cuboid.ByLengths(center, sx, sy, sz)
    else:
        start = Point.ByCoordinates(*[float(v) for v in value(spec, 'start')])
        end = Point.ByCoordinates(*[float(v) for v in value(spec, 'end')])
        size = float(value(spec, 'size'))
        if kind in ('cylinder', 'ring'):
            geometry = Cylinder.ByPointsRadius(start, end, size)
            if kind == 'ring':
                hole = Cylinder.ByPointsRadius(start, end, float(value(spec, 'inner')))
                geometry = geometry.Difference(hole)
        else:
            direction = Vector.ByTwoPoints(start, end)
            axis = direction.Normalized()
            reference = Vector.ZAxis() if abs(axis.Z) < 0.9 else Vector.YAxis()
            u = axis.Cross(reference).Normalized()
            v = axis.Cross(u).Normalized()
            midpoint = Point.ByCoordinates((start.X+end.X)/2, (start.Y+end.Y)/2, (start.Z+end.Z)/2)
            cs = CoordinateSystem.ByOriginVectors(midpoint, u, v, axis)
            geometry = Cuboid.ByLengths(cs, size, size, direction.Length)
    OUT.append(GeometryColor.ByGeometryColor(geometry, color))
# ----------------------------------------
watch_3d_airbike_pro_x = Watch3D(geometry=colored_geometry_preview)
